# Grasshopper definition 10.22.gh (Grasshopper 1.0.7)

number_slider = Slider(10, range=0..10)
pt = Point(Point(0, 0, 0))
trigrid = Triangular(Plane=pt, Size=1, ExtentX=number_slider, ExtentY=number_slider)  # -> Cells, Points
number_slider_2 = Slider(10, range=0..10)
pt_2 = Point(trigrid.Points)
crv = Curve(trigrid.Cells)
item = ListItem(List=crv, Index=number_slider_2, Wrap=True)
item_2 = ListItem(List=pt_2, Index=number_slider_2, Wrap=True)
